# Grasshopper definition DEEPSELF_fieldLines_sphere.gh (Grasshopper 1.0.7)
# plug-ins: Bifocals, Human

radians = Radians(Degrees=Slider(3.5, range=0..10))
pi = Pi(Factor=1)
division = Division(A=pi, B=radians)
range = Range(Domain=pi, Steps=division)
# RADIO
number_slider = Slider(10, range=0..100)
panel = Panel(range)
cosine = Cosine(Value=range)
sine = Sine(Value=range)
multiplication = Multiplication(A=number_slider, B=sine)
multiplication_2 = Multiplication(A=number_slider, B=cosine)
construct_point = ConstructPoint(XCoordinate=multiplication_2, YCoordinate=multiplication, ZCoordinate=0)
pi_2 = Pi(Factor=1)
multiplication_3 = Multiplication(A=multiplication, B="2")
sub_list = SubList(List=construct_point, Domain="1", Wrap=True)  # -> List, Index
multiplication_4 = Multiplication(A=multiplication_3, B=pi_2)
polyline = PolyLine(Vertices=sub_list.List, Closed=False)
length = Length(Curve=polyline)
division_2 = Division(A=multiplication_4, B=length)
round = Round(Number=division_2)  # -> Nearest, Floor, Ceiling
pi_3 = Pi(Factor=2)
range_2 = Range(Domain=pi_3, Steps=round.Ceiling)  # -> simplify(Range)
graft_tree = GraftTree(Tree=construct_point, IncludeEmptyLists=True, IncludeNullItems=True)
yz_plane = YZPlane(Origin=Point(0, 0, 0))
cull_index = CullIndex(List=range_2, Indices=0, Wrap=True)
rotate = Rotate(Geometry=graft_tree, Angle=cull_index, Plane=yz_plane)  # -> Geometry, Transform
point = Point(rotate.Geometry)
# 1.- Cargar el archivo .csv
# obtenido de TD
# 2.- Escalar los puntos en 10.
# 3.- Cargar los puntos acá
value_list = ValueList({"Repele": 1, "Atrae": -1}, selected="Atrae")
point_2 = Point([<point referenced from the Rhino model> x44])
point_charge = PointCharge(Point=point_2, Charge=value_list, Decay=2)
merge_fields = MergeFields(Fields=point_charge)
field_line = FieldLine(Field=merge_fields, Point=point, Steps=Slider(1000, range=0..1000), Accuracy=0.1, Method=3)
custom_preview_lineweights = CustomPreviewLineweights(Geometry=field_line, Shader=ColourSwatch(SwatchColor=RGB(0, 0, 0)), Absolute=False)
